# Dynamo graph Create Level.dyn (Dynamo 2.12.0.5650)

# group: Exel to Dynamo
file_path = Filename(".\Level Name Height.xlsx")
file_from_path = FileObject(path=file_path)
code_block = CodeBlock { "Floor"; }
importExcel = Data.ImportExcel(file=file_from_path, sheetName=code_block)

# group: Remove
code_block_2 = CodeBlock { 0; }
removeItemAtIndex = List.RemoveItemAtIndex(list=importExcel, indices=code_block_2)

# group: Create List
transpose = List.Transpose(lists=removeItemAtIndex)
code_block_3 = CodeBlock { 1; }
getItemAtIndex = List.GetItemAtIndex(list=transpose, index=code_block_3)
code_block_4 = CodeBlock { 0; }
getItemAtIndex_2 = List.GetItemAtIndex(list=transpose, index=code_block_4)

# group: Create Level, Ceiling and Structual (Name and Height)
byElevationAndName = Level.ByElevationAndName(elevation=getItemAtIndex, name=getItemAtIndex_2)
byLevel = FloorPlanView.ByLevel(level=byElevationAndName)
byLevel_2 = CeilingPlanView.ByLevel(level=byElevationAndName)
byLevel_3 = StructuralPlanView.ByLevel(level=byElevationAndName)
